# Dynamo graph CalculatePipeSystemVolume.dyn (Dynamo 2.10.1.3976)
# packages: Genius Loci 2022.6.16, Rhythm 2022.7.2

# group: User inputs and tools
code_block = CodeBlock {  }

# group: Filtering, gathering data, cleaning up data
# note: Colour Legend
code_block_2 = CodeBlock {  }

# group: Executing actions, manipulating the Revit model
code_block_3 = CodeBlock {  }

# group: INPUT FILTER FOR PIPE SYSTEM
# note: Press F9 in Revit to open the System Browser. Use this to determine which filter you want to use (Domestic Cold Water, Hydronic, Hydronic Supply, etc.)
system_filter = CodeBlock { "hot water heating return sm"; }

# group: Create list of pipes in a system matching the filter
categories = Categories("OST_PipeCurves")
all_elements_of_category = ElementsOfCategory(Category=categories)
code_block_4 = CodeBlock { "System Name"; }
getParameterValueByName = Element.GetParameterValueByName(element=all_elements_of_category, parameterName=code_block_4)
pipes_in_specified_system = Python(IN[0]=getParameterValueByName, IN[1]=system_filter, IN[2]=all_elements_of_category)  # CPython3
# ---------- pipes_in_specified_system.python (22 lines) ----------
# Load the Python Standard and DesignScript Libraries
import sys
import clr
clr.AddReference('ProtoGeometry')
from Autodesk.DesignScript.Geometry import *

# The inputs to this node will be stored as a list in the IN variables.
pipeSystemNames = IN[0]
filter = IN[1]
allPipeElements = IN[2]

matchingIndices = []
for system in enumerate(pipeSystemNames): 
    if filter.upper() in system[1].upper(): 
        matchingIndices.append(system[0])
        
output = []
for index in matchingIndices: 
    output.append(allPipeElements[index])

# Assign your output to the OUT variable.
OUT = output
# ----------------------------------------

# group: Select Unit System
# note: TRUE if imperial, FALSE if metric
imperial_or_metric = BoolSelector(false)

# group: Select Pipe Material
# note: Note that this assumes that the model units are inches (if imperial), or mm (if metric).
# note: TRUE if Schedule 40 stainless steel, FALSE if Type L copper
ss_or_cu_pipes = BoolSelector(true)

# group: Gather pipe lengths and areas
code_block_5 = CodeBlock { "Length"; }
pipe_lengths = Rhythm.Revit.Elements.Elements.GetParameterValueByNameTypeOrInstance(element=pipes_in_specified_system, parameterName=code_block_5)
mep_system_size = Custom[MEP System Size](element=pipes_in_specified_system)  # package Genius Loci; Retrieves the width, height or diameter of the MEP system elements (pipe, duct, cable tray, accessory...).
nominal_to_inner_diameter = Python(IN[0]=mep_system_size.Diameter, IN[1]=imperial_or_metric, IN[2]=ss_or_cu_pipes)  # CPython3
# ---------- nominal_to_inner_diameter.python (84 lines) ----------
# Load the Python Standard and DesignScript Libraries
import sys
import clr
import numpy as np
clr.AddReference('ProtoGeometry')
from Autodesk.DesignScript.Geometry import *

# The inputs to this node will be stored as a list in the IN variables.
nominalDiameters = np.array(IN[0])
isImperial = IN[1]
isSS = IN[2]

# Spreadsheet Columns: 
# Nominal diameter ("),   Nominal diameter (mm),   Sch. 40 SS ID ("),   Type L Cu ID ("),   Sch. 40 SS ID (mm),   Type L Cu ID (mm)
lookupTable = np.genfromtxt('S:\REVIT\AlanDynamoScripts\Spreadsheets\SteelCopperPipe_InnerDiameter.csv', delimiter = ',', skip_header = 1)
np.set_printoptions(precision = 3, suppress = True)
print(lookupTable)
print(np.shape(lookupTable))

def metricNominalToInner_SS(nominal):
    innerDiameter = 0
    for row in lookupTable: 
        if (nominal >= (row[1] - 2.1)) and (nominal <= row[1] + 2.1):
            innerDiameter = row[4]
            break
        else: 
            innerDiameter = nominal
    return innerDiameter

def imperialNominalToInner_SS(nominal):
    innerDiameter = 0
    for row in lookupTable: 
        if (nominal >= (row[0] - 0.1)) and (nominal <= row[0] + 0.1):
            innerDiameter = row[2]
            break
        else: 
            innerDiameter = nominal
    return innerDiameter

def metricNominalToInner_CU(nominal):
    innerDiameter = 0
    for row in lookupTable: 
        if (nominal >= (row[1] - 2.1)) and (nominal <= row[1] + 2.1):
            innerDiameter = row[5]
            break
        else: 
            innerDiameter = nominal
    return innerDiameter

def imperialNominalToInner_CU(nominal):
    innerDiameter = 0
    for row in lookupTable: 
        if (nominal >= (row[0] - 0.1)) and (nominal <= row[0] + 0.1):
            innerDiameter = row[3]
            break
        else: 
            innerDiameter = nominal
    return innerDiameter

innerArray = []

if isImperial:
    if isSS:
        for pipe in nominalDiameters:
            ID = imperialNominalToInner_SS(pipe)
            innerArray.append(ID)
    if not isSS:
        for pipe in nominalDiameters:
            ID = imperialNominalToInner_CU(pipe)
            innerArray.append(ID)


if not isImperial:
    if isSS:
        for pipe in nominalDiameters:
            ID = metricNominalToInner_SS(pipe)
            innerArray.append(ID)
    if not isSS:
        for pipe in nominalDiameters:
            ID = metricNominalToInner_CU(pipe)
            innerArray.append(ID)

# Assign your output to the OUT variable.
OUT = innerArray
# ----------------------------------------
pipe_areas = Python(IN[0]=nominal_to_inner_diameter)  # CPython3
# ---------- pipe_areas.python (18 lines) ----------
# Load the Python Standard and DesignScript Libraries
import sys
import clr
import math
import numpy as np
clr.AddReference('ProtoGeometry')
from Autodesk.DesignScript.Geometry import *

# The inputs to this node will be stored as a list in the IN variables.
pipeDiameters = IN[0]

pipeDiametersArray = np.array(pipeDiameters)


pipeAreas = math.pi * ((pipeDiametersArray / 2) ** 2)

# Assign your output to the OUT variable.
OUT = pipeAreas
# ----------------------------------------

# group: Calculate volume and convert to US Gallons from inches/mm
system_volume = Python(IN[0]=pipe_lengths, IN[1]=pipe_areas)  # CPython3
# ---------- system_volume.python (18 lines) ----------
# Load the Python Standard and DesignScript Libraries
import sys
import clr
import numpy as np
clr.AddReference('ProtoGeometry')
from Autodesk.DesignScript.Geometry import *

# The inputs to this node will be stored as a list in the IN variables.
lengths = IN[0]
areas = IN[1]

lengthsArray = np.array(lengths)
areasArray = np.array(areas)

systemVolume = np.dot(lengthsArray, areasArray)

# Assign your output to the OUT variable.
OUT = systemVolume
# ----------------------------------------
volume_usg = Python(IN[0]=system_volume, IN[1]=imperial_or_metric)  # CPython3
# ---------- volume_usg.python (17 lines) ----------
# Load the Python Standard and DesignScript Libraries
import sys
import clr
clr.AddReference('ProtoGeometry')
from Autodesk.DesignScript.Geometry import *

# The inputs to this node will be stored as a list in the IN variables.
volumeIn = IN[0]
isImperial = IN[1]

if isImperial:
    volumeGallons = (volumeIn / (12 ** 3)) * 7.481
else: 
    volumeGallons = (volumeIn / (1000 ** 3)) * 264.172

# Assign your output to the OUT variable.
OUT = volumeGallons
# ----------------------------------------
# note: This is the total system volume in US gallons. Please double check that you've set the units correctly in the blue boxes below!
watch = Watch(volume_usg)

# group: Use this to verify you've filtered systems appropriately
# note: The Watch node will display all of the systems to be sized by the program.
code_block_6 = CodeBlock { "System Name"; }
getParameterValueByName_2 = Element.GetParameterValueByName(element=pipes_in_specified_system, parameterName=code_block_6)
watch_2 = Watch(getParameterValueByName_2)
