# Dynamo graph CopyFixturesFromArchitectModel.dyn "CopyFixturesFromArchitect" (Dynamo 2.10.1.3976)
# packages: bimorphNodes 4.0.9, Genius Loci 2022.6.16, MEPover 2022.1.1, Rhythm 2022.7.2, Clockwork for Dynamo 2.x 2.4.0

# note: IMPORTANT: This script is still a work in progress. It has not been tested and will likely not work on any projects that aren't 22026 Ajax LTC.

# group: Inputs
links = Links("996 Ajax LTC.rvt : 2 : location <Not Shared>")
# note: Select the architect's model.
filter_casework_for_this_word = CodeBlock { "sink"; }
# note: (Filters use OR logic)
# note: Can add more filters on request.
filter_casework_for_this_word_2 = CodeBlock { "vanity"; }

# group: Select Fixtures in Linked Model
categories = Categories("OST_PlumbingFixtures")
linked_plumbing_fixtures = Revit.LinkElement.OfCategory(linkInstance=links, category=categories)
categories_2 = Categories("OST_Casework")
linked_casework = Revit.LinkElement.OfCategory(linkInstance=links, category=categories_2)

# group: Filtering and Merging Fixture Lists
merge_lists_unused = Python()  # CPython3; frozen; unwired: IN[0], IN[1]
# ---------- merge_lists_unused.python (20 lines) ----------
# Load the Python Standard and DesignScript Libraries
import sys
import clr
clr.AddReference('ProtoGeometry')
from Autodesk.DesignScript.Geometry import *

# The inputs to this node will be stored as a list in the IN variables.
plumbingFixtures = IN[0]
sinks = IN[1]

mergedList = []

for fixture in plumbingFixtures:
    mergedList.append(fixture)
    
for sink in sinks: 
    mergedList.append(sink)

# Assign your output to the OUT variable.
OUT = mergedList
# ----------------------------------------
linked_casework_family_types = Revit.LinkElement.ElementType(linkElement=linked_casework)
linked_sinks_only = Python(IN[0]=linked_casework, IN[1]=linked_casework_family_types, IN[2]=filter_casework_for_this_word, IN[3]=filter_casework_for_this_word_2)  # CPython3
# ---------- linked_sinks_only.python (34 lines) ----------
# Load the Python Standard and DesignScript Libraries
import sys
import clr
clr.AddReference('ProtoGeometry')
from Autodesk.DesignScript.Geometry import *

# The inputs to this node will be stored as a list in the IN variables.
linkedCaseworkList = IN[0]
caseworkFamilyTypes = IN[1]
filter1 = IN[2]
filter2 = IN[3]
stringFamilyTypeList = []
filters = []

for filter in IN[2:]:
    filters.append(filter)
    
for familyType in caseworkFamilyTypes: 
    stringFamily = str(familyType)
    stringFamilyTypeList.append(stringFamily)

sinkIndexList = []
for filter in filters: 
    for index, string in enumerate(stringFamilyTypeList):
        if filter.upper() in string.upper():
            sinkIndexList.append(index)        
        
linkedSinkList = []
for index, casework in enumerate(linkedCaseworkList):
    if index in sinkIndexList:
        linkedSinkList.append(casework)

# Assign your output to the OUT variable.
OUT = linkedSinkList
# ----------------------------------------

python_script = Python(IN[0]=linked_plumbing_fixtures)  # CPython3
# ---------- python_script.python (15 lines) ----------
# Load the Python Standard and DesignScript Libraries
import sys
import clr
clr.AddReference('ProtoGeometry')
from Autodesk.DesignScript.Geometry import *

# The inputs to this node will be stored as a list in the IN variables.
input = IN[0]
output = input[:347]

for item in input[349:351]:
    output.append(item)

# Assign your output to the OUT variable.
OUT = output
# ----------------------------------------

# group: Place Linked Objects in Document
copyToActiveDocument = Revit.LinkElement.CopyToActiveDocument(linkElements=linked_sinks_only)

# group: Tag the Placed Sinks
categories_3 = Categories("OST_Views")
all_elements_of_category = ElementsOfCategory(Category=categories_3)
filter_all_views_for_this = CodeBlock { "piping"; }
# note: For speed of testing, the python node is filtering for just the first floor. Delete this when all issues are fixed.
all_piping_views = Python(IN[0]=all_elements_of_category, IN[1]=filter_all_views_for_this)  # CPython3
# ---------- all_piping_views.python (29 lines) ----------
# Load the Python Standard and DesignScript Libraries
import sys
import clr
clr.AddReference('ProtoGeometry')
from Autodesk.DesignScript.Geometry import *

# The inputs to this node will be stored as a list in the IN variables.
allViews = IN[0]
filter = IN[1]
strAllViews = []

for view in allViews: 
    strView = str(view)
    strAllViews.append(strView)

pipingViewIndices = []
for index, string in enumerate(strAllViews):
    if filter.upper() in string:
        pipingViewIndices.append(index)

pipingViews = []
for index, view in enumerate(allViews):
    if index in pipingViewIndices:
        pipingViews.append(view)

# Place your code below this line

# Assign your output to the OUT variable.
OUT = pipingViews
# ----------------------------------------
python_script_2 = Python(IN[0]=all_piping_views)  # CPython3
# ---------- python_script_2.python (13 lines) ----------
# Load the Python Standard and DesignScript Libraries
import sys
import clr
clr.AddReference('ProtoGeometry')
from Autodesk.DesignScript.Geometry import *

# The inputs to this node will be stored as a list in the IN variables.
allPipingViews = IN[0]

output = allPipingViews[0]

# Assign your output to the OUT variable.
OUT = output
# ----------------------------------------
getLocation = Element.GetLocation(element=copyToActiveDocument)
family_types = FamilyTypes("Casework Tag:Boxed")
boolean = BoolSelector(true)
create_tag = Custom[Create Tag](view=python_script_2@L1, element=copyToActiveDocument, TagLocation=getLocation, TagType=family_types, addLeader=boolean, RunIt=boolean, lacing=Longest)  # package Genius Loci; Works only in Revit 2018 and later. Creates a tag at a given location, of given type and in a supplied view. The node also works with Linked Elements (except space and area), Multi Category tag and Material Tag. Based on an archilab node
# note: On each view, every single fixture and sink is being tagged, regardless of whether it's visible or not. There are 12 views, so each fixture gets tagged a total of 12 times. This makes for a very slow and inefficient program.
tag_get_view = Custom[Tag Get View](tags=create_tag@L1)  # package MEPover; Return the view on which the tag is placed
# note: TO DO: Figure out a way to filter fixtures by floor or view, and tag one level at a time. Get rid of the unnecessary tagging.
tag_get_location = Custom[Tag Get Location](tags=create_tag@L1)  # package MEPover; Returns the location of the tags

passthrough = Custom[Passthrough](passThrough=python_script, waitFor=create_tag)  # package Clockwork for Dynamo 2.x; Forces a sequential order of execution. The node wired into the output of the Passthrough node will be executed *after* the node wired into the waitFor input (e.g. important for some Revit operations). The value of the passThrough input will be passed on to the node wired into the output port of the Passthrough node.

# group (continued): Place Linked Objects in Document
copyToActiveDocument_2 = Revit.LinkElement.CopyToActiveDocument(linkElements=passthrough)

# group: Tag the Placed Plumbing Fixtures
categories_4 = Categories("OST_Views")
all_elements_of_category_2 = ElementsOfCategory(Category=categories_4)
filter_all_views_for_this_2 = CodeBlock { "piping"; }
all_piping_views_2 = Python(IN[0]=all_elements_of_category_2, IN[1]=filter_all_views_for_this_2)  # CPython3; same code as all_piping_views
# note: For speed of testing, the python node is filtering for just the first floor. Delete this when all issues are fixed.
python_script_3 = Python(IN[0]=all_piping_views_2)  # CPython3; same code as python_script_2
getLocation_2 = Element.GetLocation(element=copyToActiveDocument_2)
family_types_2 = FamilyTypes("Plumbing Fixture Tag:Boxed")
boolean_2 = BoolSelector(true)
create_tag_2 = Custom[Create Tag](view=python_script_3@L1, element=copyToActiveDocument_2, TagLocation=getLocation_2, TagType=family_types_2, addLeader=boolean_2, RunIt=boolean_2, lacing=Longest)
tag_get_view_2 = Custom[Tag Get View](tags=create_tag_2@L1)
tag_get_location_2 = Custom[Tag Get Location](tags=create_tag_2@L1)

# note: In the plumbing fixtures list, indices 347 and 348 (IDs 53668628 and 53668629) are causing the placing node to crash due to "invalid ID". Python node is filtering them out for now. These fixtures are the country kitchen sink and a single sink in the L1 kitchen area.
# note: TO DO: Figure out why these two sinks have an invalid ID and aren't selectable.
python_script_4 = Python(IN[0]=linked_plumbing_fixtures)  # IronPython2
# ---------- python_script_4.python (13 lines) ----------
# Load the Python Standard and DesignScript Libraries
import sys
import clr
clr.AddReference('ProtoGeometry')
from Autodesk.DesignScript.Geometry import *

# The inputs to this node will be stored as a list in the IN variables.
input = IN[0]

output = input[346]

# Assign your output to the OUT variable.
OUT = output
# ----------------------------------------

# group: Executing actions, manipulating the Revit model
code_block = CodeBlock {  }

# group: Filtering, gathering data, cleaning up data
# note: Colour Legend
code_block_2 = CodeBlock {  }

# group: User inputs and tools
code_block_3 = CodeBlock {  }
