# Dynamo graph TagAllHeatPumpsInCurrentView.dyn (Dynamo 2.10.1.3976)
# packages: archi-lab.net 2022.212.3222, Genius Loci 2022.6.16

# group: TOGGLE THIS BETWEEN RUNS!
refresh = BoolSelector(true)

# group: Gets the Current Active View in Revit
current = Document.Current()
if_ = If(test=refresh, true=current, false=current)
activeView = Document.ActiveView(document=if_)

# group: Select Object Category and Apply Filter
categories = Categories("OST_MechanicalEquipment")
filter_for_this = CodeBlock { "50PCH"; }

# group: Selects all Heat Pumps in the Model
all_elements_of_category = ElementsOfCategory(Category=categories)
all_heat_pumps = Python(IN[0]=all_elements_of_category, IN[1]=filter_for_this)  # CPython3
# ---------- all_heat_pumps.python (19 lines) ----------
# Load the Python Standard and DesignScript Libraries
import sys
import clr
clr.AddReference('ProtoGeometry')
from Autodesk.DesignScript.Geometry import *

# The inputs to this node will be stored as a list in the IN variables.
equipment = IN[0]
filter = IN[1]

output = []

for item in enumerate(equipment):
    if filter in str(item[1]):
        output.append(item[1])
    

# Assign your output to the OUT variable.
OUT = output
# ----------------------------------------

# group: Filters for Heat Pumps in the Current Active View
isVisible = archilab.Revit.Elements.Elements.IsVisible(element=all_heat_pumps, view=activeView)
heat_pumps_visible_in_current = Python(IN[0]=all_heat_pumps, IN[1]=isVisible)  # "Heat Pumps Visible in Current View"; CPython3
# ---------- heat_pumps_visible_in_current.python (22 lines) ----------
# Load the Python Standard and DesignScript Libraries
import sys
import clr
clr.AddReference('ProtoGeometry')
from Autodesk.DesignScript.Geometry import *

# The inputs to this node will be stored as a list in the IN variables.
heatPumpList = IN[0]
isVisibleInView = IN[1]

indices = []
for bool in enumerate(isVisibleInView):
	if bool[1]:
	   indices.append(bool[0])

output = []
for index in indices: 
    output.append(heatPumpList[index])
# Place your code below this line

# Assign your output to the OUT variable.
OUT = output
# ----------------------------------------

# group: What Kind of Tag Are You Placing?
# note: Run once, then toggle this. Run again on a new view, toggle again, etc.
# Changing this refreshes the current active view. If you don't toggle this boolean, then the active view does not change.
family_types = FamilyTypes("Mechanical Equipment Tag:Heat Pump Symbol")

# group: Place Tags on Selected Objects
getLocation = Element.GetLocation(element=heat_pumps_visible_in_current)
enable_tagging = BoolSelector(true)
create_tag = Custom[Create Tag](view=activeView@L1, element=heat_pumps_visible_in_current, TagLocation=getLocation, TagType=family_types, RunIt=enable_tagging, lacing=Longest)  # package Genius Loci; Works only in Revit 2018 and later. Creates a tag at a given location, of given type and in a supplied view. The node also works with Linked Elements (except space and area), Multi Category tag and Material Tag. Based on an archilab node

# group: Filtering, gathering data, cleaning up data
# note: Colour Legend
code_block = CodeBlock {  }

# group: Executing actions, manipulating the Revit model
code_block_2 = CodeBlock {  }

# group: User inputs and tools
code_block_3 = CodeBlock {  }
